% Simulink data dictionary ConfigData.sldd

SoundSpeed = 300
CanaryAmplitude = 1
CanaryCarrierFrequency = 20000
CanaryDataRate = 100
DataAmplitude = 10
PreConvolveDownsample = 32
WalshCodeIndex = [3 9]

WalshCodeCache = [1 1
 1 1
 1 1
 1 1
 1 1
 1 1
 1 1
 1 1
 1 1
 1 1
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 ]

SampleRate = 48000
Sig = Simulink.Signal()
FmFrequencyDifferential = 100